# Grasshopper definition Homework_Parametric Armband.gh (Grasshopper 1.0.8)

count = Slider(20, range=0..100)
r_sphere = Slider(12, range=0..100)
radius = Slider(48, range=0..100)
get_number = GetNumber(count, AtLeast=1, AtMost=1, Maximum=1.797693135e+308, Minimum=-1.797693135e+308, TreeAccess=False)
get_number_2 = GetNumber(radius, AtLeast=1, AtMost=1, Maximum=1.797693135e+308, Minimum=-1.797693135e+308, TreeAccess=False)
get_number_3 = GetNumber(r_sphere, AtLeast=1, AtMost=1, Maximum=1.797693135e+308, Minimum=-1.797693135e+308, TreeAccess=False)
circle = Circle(Plane=PlaneXY(0, 0, 0), Radius=get_number_2)
area = Area(Geometry=circle)  # -> Area, Centroid
series = Series(Start=0, Step=expr("x*2", get_number_3), Count=get_number)
divide_curve = DivideCurve(Curve=circle, Count=get_number, Kinks=False)  # -> Points, Tangents, Parameters
unit_z = UnitZ(Factor=series)
sphere = Sphere(Base=divide_curve.Points, Radius=get_number_3)
division = Division(A=360, B=get_number)
move = Move(Geometry=graft(sphere), Motion=graft(unit_z))  # -> Geometry, Transform
series_2 = Series(Start=0, Step=division, Count=get_number)
rotate = Rotate(Geometry=move.Geometry, Angle=degrees(series_2), Plane=area.Centroid)  # -> Geometry, Transform
list_length = ListLength(List=rotate.Geometry)
division_2 = Division(A=1, B=list_length)
area_2 = Area(Geometry=rotate.Geometry)  # -> Area, Centroid
series_3 = Series(Start=0.01, Step=division_2, Count=list_length)
scale = Scale(Geometry=rotate.Geometry, Center=area_2.Centroid, Factor=series_3)  # -> Geometry, Transform
context_bake = ContextBake(Content=scale.Geometry)
